# Grasshopper definition Su_[A1-2]-3.gh (Grasshopper 1.0.7)
# plug-ins: Anemone, EleFront

number_slider = Slider(10, range=0..10)
mesh = Mesh(<mesh referenced from the Rhino model>)
loop_start = LoopStart(Repeat=Slider(18, range=0..100), Trigger=Button(), Data=mesh)  # -> port, Counter, Data
ghpython_script = GhPythonScript(x=loop_start.Counter)  # -> out, a, b; inputs x: Int32
# ---------- ghpython_script: Python ----------
import rhinoscriptsyntax as rs
import random
import math


c = x
a = random.randint(0,c)
b = random.randint(0,4)
# ---------- end ghpython_script ----------
number_slider_2 = Slider(3, range=0..10)

boolean_toggle = BooleanToggle(True)
mesh_2 = Mesh(<mesh referenced from the Rhino model>)
cluster = Cluster(inputmesh_only_one=mesh_2, seed_0_3=Slider(8, range=0..10))
mesh_3 = Mesh(cluster)
bake_objects = BakeObjects(Geometry=mesh_3, Bake=False)

merge = Merge(Data1=ghpython_script.a, Data2=ghpython_script.b)
list_item = ListItem(List=loop_start.Data, Index=ghpython_script.a, Wrap=True)
cluster_2 = Cluster(inputmesh_only_one=list_item, seed_0_3=ghpython_script.b)
panel = Panel(merge)
mesh_4 = Mesh(cluster_2)
merge_2 = Merge(Data1=loop_start.Data, Data2=mesh_4)  # -> flatten(Result)
bake_objects_2 = BakeObjects(Geometry=mesh_4, Bake=False)  # disabled
loop_end = LoopEnd(port=loop_start.port, Exit=False, Data=merge_2, TimeOutVal=0, pausedState=False, state="Output last")
clean_tree = CleanTree(RemoveNulls=True, RemoveInvalid=True, RemoveEmpty=False, Tree=loop_end)
mesh_5 = Mesh(clean_tree)
group = Group(Objects=mesh_5)

number_slider_3 = Slider(20, range=0..100)  # disabled
multiplication = Multiplication(A=loop_start.Counter, B=number_slider_3)  # disabled
unit_y = UnitY(Factor=multiplication)  # disabled
move = Move(Geometry=group, Motion=unit_y)  # -> Geometry, Transform; disabled

data_recorder = DataRecorder(group, DataLimit=-10, RecordData=True)
panel_2 = Panel(data_recorder)
group_2 = Group(data_recorder)
list_length = ListLength(List=group_2)
series = Series(Start=0, Step=Slider(20, range=0..100), Count=list_length)
unit_y_2 = UnitY(Factor=series)
move_2 = Move(Geometry=group_2, Motion=unit_y_2)  # -> Geometry, Transform

# ==== cluster Cluster
inputmesh_only_one = ClusterInput()
inputmesh_only_one_2 = Mesh(inputmesh_only_one)
seed_0_3 = ClusterInput()
seed_0_3_2 = Integer(seed_0_3)

# ---- group: Basic
face_boundaries = FaceBoundaries(Mesh=inputmesh_only_one_2)
face_normals = FaceNormals(Mesh=inputmesh_only_one_2)  # -> Centers, Normals
list_item = ListItem(List=face_boundaries, Index=seed_0_3_2, Wrap=True)
list_item_2 = ListItem(List=face_normals.Normals, Index=seed_0_3_2, Wrap=True)

# ---- group: Get the end direction
addition = Addition(A=seed_0_3_2, B=2)
list_item_3 = ListItem(List=face_normals.Normals, Index=addition, Wrap=True)

# ---- group: Get the moving end
explode = Explode(Curve=list_item, Recursive=True)  # -> Segments, Vertices
sort_list = SortList(Keys=explode.Segments, ValuesValuesA=explode.Segments)  # -> Keys, ValuesValuesA
list_item_4 = ListItem(List=sort_list.ValuesValuesA, Index=1, Wrap=True)
curve_middle = CurveMiddle(Curve=list_item_4)

# ---- group: Get the moving Start
deconstruct_mesh = DeconstructMesh(Mesh=inputmesh_only_one_2)  # -> Vertices, Faces, Colours, Normals
cull_duplicates = CullDuplicates(Points=deconstruct_mesh.Vertices, Tolerance=0.1, CullMode=3)  # -> Points, Indices, Valence
list_compare = ListCompare(List=cull_duplicates.Points, UniquePairs=False)  # -> Base, Comparison
line = Line(StartPoint=list_compare.Base, EndPoint=list_compare.Comparison)  # -> flatten(Line)
sort_list_2 = SortList(Keys=line, ValuesValuesA=line)  # -> Keys, ValuesValuesA
list_item_5 = ListItem(List=sort_list_2.ValuesValuesA, Index=-1, Wrap=True)
end_points = EndPoints(Curve=list_item_5)  # -> Start, End
merge = Merge(Data1=end_points.Start, Data2=end_points.End)
closest_points = ClosestPoints(Point=curve_middle, Cloud=merge, Count=3)  # -> ClosestPoint, CPIndex, Distance
sort_list_3 = SortList(Keys=closest_points.Distance, ValuesValuesA=closest_points.ClosestPoint)  # -> Keys, ValuesValuesA
list_item_6 = ListItem(List=sort_list_3.ValuesValuesA, Index=0, Wrap=True)

# ---- group: Get the rotate axis
mesh_edges = MeshEdges(Mesh=inputmesh_only_one_2)  # -> NakedEdges, InteriorEdges, NonManifoldEdges
curve = Curve(mesh_edges.InteriorEdges)
end_points_2 = EndPoints(Curve=curve)  # -> Start, End
merge_2 = Merge(Data1=graft(end_points_2.Start), Data2=graft(end_points_2.End))
set_difference = SetDifference(SetA=merge_2, SetB=list_item_6)
list_length = ListLength(List=set_difference)
list_item_7 = ListItem(List=list_length, Index=0, Wrap=True)
equality = Equality(FirstNumber=list_item_7, SecondNumber=Slider(1, range=0..1))  # -> flatten(Equality), Inequality
dispatch = Dispatch(List=curve, DispatchPattern=equality.Equality)  # -> ListA, ListB
curve_2 = Curve(dispatch.ListA)
end_points_3 = EndPoints(Curve=curve_2)  # -> Start, End

# ---- group: Transforming
rotate_direction = RotateDirection(Geometry=inputmesh_only_one_2, Center=end_points_3.Start, From=list_item_2, To=list_item_3)  # -> Geometry, Transform
vector_2pt = Vector2Pt(PointA=list_item_6, PointB=curve_middle, Unitize=False)  # -> Vector, Length
move = Move(Geometry=rotate_direction.Geometry, Motion=vector_2pt.Vector)  # -> Geometry, Transform

# ----
output_mesh_addition = Mesh(move.Geometry)
output_mesh_addition_2 = ClusterOutput(output_mesh_addition)
